# Grasshopper definition Chainlink.gh (Grasshopper 1.0.7)
# plug-ins: Human, Kangaroo2 Components

# ----
# Link Size
outsidelength = Slider(2, range=0.1..10)
outsideheight = Slider(1.25, range=0.1..10)
diam = Slider(0.301, range=0.1..1)
list = ValueList({"PolySurface": 1, "SuBD": 2, "Mesh": 3}, selected="SuBD")

# ----
# Choose Base Curve For Chainlink
curve_to_use = ValueList({"Existing Curve": 1, "Catenary": 2}, selected="Existing Curve")
selectedcurve = Curve()

# ---- group: Create Link
ouside_length = Number(outsidelength)
ouside_height = Number(outsideheight)
geo_type = Number(list)
diam_2 = Number(diam)
python = GhPythonScript(Length=ouside_length, Height=ouside_height, Diam=diam_2)  # -> out, rectX, rectY
# ---------- python: Python ----------
__author__ = "David Moreau"
__version__ = "2021.02.24"

import rhinoscriptsyntax as rs

rectX = Length-Diam
rectY = Height - Diam
# ---------- end python ----------
X = UnitX(Factor=expr("x*-1", diam_2))
Y = UnitY(Factor=expr("x*-.5", python.rectY))
xy = XYPlane(Origin=Point(0, 0, 0))
addition = Addition(A=Y, B=X)
move = Move(Geometry=xy, Motion=addition)  # -> Geometry, Transform
pln = Plane(move.Geometry)
rectangle = Rectangle(Plane=pln, XSize=python.rectX, YSize=python.rectY, Radius=expr("x*.5", python.rectY))  # -> Rectangle, Length
num = Number(diam_2)
mp = MultiPipe(Curves=rectangle.Rectangle, NodeSize=expr("x/2", num), EndOffset=1, StrutSize=1, Segment=0, KinkAngle=0.6, CubeFit=0)
pipe = Pipe(Curve=rectangle.Rectangle, Radius=expr("x*.5", diam_2), Caps=0)
list_2 = ValueList({"One": 1, "Two": 2, "Three": 3}, selected="One")
python_2 = GhPythonScript(chainLinkType=geo_type, Polysurface=pipe, SubD=mp, SubDMeshLevel=list_2)  # -> out, a
# ---------- python_2: Python ----------
__author__ = "David Moreau"
__version__ = "2021.03.29"

import rhinoscriptsyntax as rs
import Rhino

if chainLinkType == 1:
    a = Polysurface

if chainLinkType == 2:
    a = SubD
    
if chainLinkType == 3:
    toMesh = rs.coercegeometry(SubD)
    a = Rhino.Geometry.Mesh.CreateFromSubD(toMesh, SubDMeshLevel) #create mesh
# ---------- end python_2 ----------
link_geo = Geometry(python_2.a)
diam_3 = Number(diam_2)

# ---- group: Catenary Controls
start_pt = Point()
end_pt = Point()
lengthmultiplier = Slider(2.05, range=1..10)

# ---- group: Make Catenary
dist = Distance(PointA=start_pt, PointB=end_pt)
multiplication = Multiplication(A=dist, B=lengthmultiplier)
reb = RebuildCurve(Curve=selectedcurve, Count=Slider(543, range=1..1000), Tangents=False)
cat = Catenary(PointA=start_pt, PointB=end_pt, Length=multiplication, Gravity=Vector(0, 0, -1))
len = Length(Curve=cat)
choosebasescript = GhPythonScript(baseType=curve_to_use, Catenary=cat, SelectedCurve=reb)  # -> out, a
# ---------- choosebasescript: Python ----------
__author__ = "David Moreau"
__version__ = "2021.03.26"

import rhinoscriptsyntax as rs


if baseType == 1:
    a = SelectedCurve

#catenary
if baseType == 2:
    a = Catenary
# ---------- end choosebasescript ----------
crv = Curve(choosebasescript.a)

# ---- group: Catenary Controls (continued)
cat_length = Panel(len)

# ---- group: Create Chain
ouside_length_2 = Number(ouside_length)
base_curve = Curve(crv)
diam_4 = Number(diam_3)
link_geo_2 = Geometry(link_geo)
python_3 = GhPythonScript(Curve=base_curve, Length=ouside_length_2, Diam=diam_4)  # -> out, Number
# ---------- python_3: Python ----------
__author__ = "David Moreau"
__version__ = "2021.02.24"

import rhinoscriptsyntax as rs

crvLength = rs.CurveLength(Curve)


Number = int(crvLength / (Length-2*Diam))
# ---------- end python_3 ----------
frames = CurveFrames(Curve=base_curve, Count=python_3.Number)  # -> Frames, Parameters
orient = Orient(Geometry=link_geo_2, Source=PlaneXY(0, 0, 0), Target=frames.Frames)  # -> Geometry, Transform
dispatch = Dispatch(List=orient.Geometry, DispatchPattern=[True, False])  # -> ListA, ListB
dispatch_2 = Dispatch(List=frames.Frames, DispatchPattern=[True, False])  # -> ListA, ListB
deplane = DeconstructPlane(Plane=dispatch_2.ListA)  # -> Origin, XAxis, YAxis, ZAxis
rot3d = Rotate3D(Geometry=dispatch.ListA, Angle=degrees(Slider(71, range=1..180)), Center=deplane.Origin, Axis=deplane.XAxis)  # -> Geometry, Transform

# ----
geo = Geometry([rot3d.Geometry, dispatch.ListB])

# ----
# Bake Controls
# Turn Update Layer Toggle Off then On
# to Update Current Layer
update_current_layer = BooleanToggle(True)
bake = Button()

# ---- group: Bake To Rhino
getgroupindex = GhPythonScript(toggle=bake)  # -> out, groupIndex
# ---------- getgroupindex: Python ----------
__author__ = "David Moreau"
__version__ = "2021.05.28"

import Rhino

def getIndex():
    groupTable = test = Rhino.RhinoDoc.ActiveDoc.Groups
    
    groupIndexes = []
    index = 0
    
    for g in groupTable:
        groupIndexes.append(g.Index)
    
    groupIndexes.sort()
    
    gI= groupIndexes[-1] + 1
    return gI

if toggle == True:
    groupIndex = getIndex()
# ---------- end getgroupindex ----------
ghpython_script = GhPythonScript(x=update_current_layer)  # -> out, layername
# ---------- ghpython_script: Python ----------
__author__ = "David Moreau"
__version__ = "2021.05.05"

import rhinoscriptsyntax as rs
import Rhino
import scriptcontext

if x == True:
    layername = Rhino.RhinoDoc.ActiveDoc.Layers.CurrentLayer.FullPath
# ---------- end ghpython_script ----------
createatts = CreateAttributes(Name="ChainLink", LayerName=ghpython_script.layername, GroupIndices=getgroupindex.groupIndex, enableFullPath=True)
bake_2 = BakeGeometry(Bake=bake, Geometry=geo, Attributes=createatts, DeleteOldBakes=False, PreserveTrees=False)

# ----
current_layer = Panel(ghpython_script.layername)
